# Grasshopper definition 00_UR_basicSettings.ghx (Grasshopper 1.0.7)

# ----
# Joint angles of robot safety position
robot_joint_angles = Panel("""-180.00
-109.78
150.91
-131.22
-90.00
180.00""")

pt = ConstructPoint(XCoordinate="395", YCoordinate="267", ZCoordinate="45")

reset_parameters = Button()

# ----
# Fabrication Parameters
vel_in_mm_s = Slider(60, range=0..100)
accel = Slider(0.05, range=0..0.1)
wait = Slider(1.2, range=0..2)
drop_dis = Slider(15, range=-50..900)
division = Division(A=vel_in_mm_s, B="1000")

# ----
# Slice List
max_drop_counts = Panel("299")
slice_length = Slider(250, range=0..500)

# ---- group: Select Target Pt
list = ValueList({"//": 0, "///": 1, "////": 2}, selected="//")
filter = StreamFilter(Gate=list, Stream0=pt)

# ----
tcp_h = Slider(0, range=0..300)
io = BooleanToggle(False)

# ----
# Set robot to safety position
# BEFOR or AFTER printing.
safetyposition = Button()

# ----
# Move robot to a certain point
targetpt = Button()

python = GhPythonScript(
    vel=division,
    accel=accel,
    wait=wait,
    drop_distance=drop_dis,
    max_drops=max_drop_counts,
    slice_length=slice_length,
    reset=reset_parameters)  # -> visualization, way_plane_nlist, vel_nlist, accel_nlist, wait_nlist, drop_distance_nlist, a; inputs way_plane_nlist: list, max_drops: Int32, slice_length: Int32, reset: Boolean
# ---------- python: Python ----------
import Rhino.Geometry as rg
import ghpythonlib.components as ghc
import ghpythonlib.treehelpers as th
from compas_ghpython import ghtree_to_list, list_to_ghtree 
from scriptcontext import sticky as drop_params

from compas_rhino import unload_modules
unload_modules('data_structure')
import data_structure as ds

if reset:
    drop_params.clear()
else:
    drop_params['planes'] = way_plane_nlist
    drop_params['velocities'] = ds.duplicate_data(way_plane_nlist, vel)
    drop_params['accelerations'] = ds.duplicate_data(way_plane_nlist, accel)
    drop_params['waits'] = ds.duplicate_data(way_plane_nlist, wait)
    drop_params['distances'] = ds.duplicate_data(way_plane_nlist, drop_distance)
    drop_params['constant_velocity'] = vel
    drop_params['constant_acceleration'] = accel
    drop_params['ed_x'] = ed_x
    drop_params['ed_y'] = ed_y
    drop_params['ed_z'] = ed_z


all_planes = ds.flatten_nlist(drop_params['planes'])

if len(all_planes) <= max_drops:
    for key, items in drop_params.items():
        way_plane_nlist     = drop_params['planes']
        vel_nlist           = drop_params['velocities'] 
        accel_nlist         = drop_params['accelerations']
        wait_nlist          = drop_params['waits']
        drop_distance_nlist = drop_params['distances'] 

else:
    for key, items in drop_params.items():
        if key == 'planes':
            way_plane_nlist = ds.rearrange_nlist(items, slice_length)
        elif key == 'velocities':
            vel_nlist = ds.rearrange_nlist(items, slice_length)
        elif key == 'accelerations':
            accel_nlist = ds.rearrange_nlist(items, slice_length)
        elif key == 'waits':
            wait_nlist = ds.rearrange_nlist(items, slice_length)
        elif key == 'distances':
            drop_distance_nlist = ds.rearrange_nlist(items, slice_length)


"""
Check whether all data lengths are equal
"""

for i in range(len(way_plane_nlist)):
    if len(way_plane_nlist[i]) == len(vel_nlist[i]) == len(accel_nlist[i]) == len(wait_nlist[i]) == len(drop_distance_nlist[i]):
        print ('ok', 'length : ', len(way_plane_nlist[i]))
    else:
        print ('data len doesnt match :', i)

"""Visualization in GH"""
visualization = list_to_ghtree (way_plane_nlist)
# ---------- end python ----------
conplane = GhPythonScript(pt=filter)  # -> plane; inputs pt: Point3d
# ---------- conplane: Python ----------
import Rhino.Geometry as rg

plane = rg.Plane(pt, rg.Vector3d.XAxis, rg.Vector3d.YAxis)
# ---------- end conplane ----------
sendtopoint = GhPythonScript(joints=robot_joint_angles, target_plane=conplane, tcp_height=tcp_h, IO=io, send_safePos=safetyposition, send=targetpt)  # -> out, script; inputs joints: list, target_plane: Plane, IO: Boolean, send_safePos: Boolean
# ---------- sendtopoint: Python ----------
from compas_rhino import unload_modules
unload_modules('simple_ur_script')
unload_modules('simple_comm')
import simple_comm as c
import simple_ur_script as ur
import Rhino.Geometry as rg
import math as m

#ed_x = 52.5
#ed_y = 85.5
#ed_z = 161.5

ed_x = 0
ed_y = 0
ed_z = 0

T = rg.Transform.Translation(0,0,tcp_height)
target_plane.Transform(T)

velocity = 0.04
acceleration = 0.02


if send_safePos:
    script = ""
    joints = [m.radians(joints[i]) for i in range(len(joints))]
    script += ur.move_j(joints, acceleration, velocity)
    script = c.concatenate_script("def sendToSafePos():",script)
    c.send_script(script,"192.168.10.10")

elif send:
    script = ""
    script += ur.set_standard_analog_out(0,0)
    script += ur.set_tcp_by_angles(ed_x, ed_y, ed_z, m.radians(-180.0), m.radians(0.0), m.radians(-90.0))
    script += ur.move_l(target_plane, acceleration, velocity)

    """
    TEST
    """
    if IO:
        script += ur.set_digital_out(0, True)#Turn on air
        script += ur.set_standard_analog_out(0,0.3)#0.3 = 3.0 Voltage                                                                                               
        script += ur.sleep(30)
        script += ur.set_standard_analog_out(0,0)
    """
    TEST
    """

    script = c.concatenate_script("def sendToPt():",script)
    c.send_script(script,"192.168.10.10")
# ---------- end sendtopoint ----------

# ----
# Fabricating :)
predrop_count = Slider(8, range=0..100)
send_pre_dropping = Button()
send_dropping = Button()

# ----
# Modify it when data needs to be sliced
l_index = Slider(0, range=0..100)

panel = Panel(sendtopoint.script)

# ----
# Generate script
dropping = GhPythonScript(l_index=l_index, preDrop_count=predrop_count)  # -> script_D; inputs way_plane_nlist: list, material_nlist: list, vel_nlist: list, accel_nlist: list, wait_nlist: list, drop_distance_nlist: list, l_index: Int32, preDrop_count: Int32
# ---------- dropping: Python ----------
import ghpythonlib.components as ghc
import ghpythonlib.treehelpers as th
from compas_ghpython import ghtree_to_list, list_to_ghtree 
import Rhino.Geometry as rg
import math as m

from compas_rhino import unload_modules
unload_modules('simple_ur_script')
unload_modules('simple_comm')
unload_modules('sticky')
import simple_comm as c
import simple_ur_script as ur
from scriptcontext import sticky as drop_params

velocity = drop_params['constant_velocity']
acceleration = drop_params['constant_acceleration']
ed_x = drop_params['ed_x']
ed_y = drop_params['ed_y']
ed_z = drop_params['ed_z']


script = ""
script += ur.textmsg("Dropping index: ",l_index )
script += ur.set_tcp_by_angles(ed_x*-1, ed_z + drop_dis, ed_y, m.radians(91.0), m.radians(0.0), m.radians(0.0))
script += ur.set_digital_out(2, True)#Activate Fan

#   Move to pre drop location
script += ur.move_j([m.radians(109.10),m.radians(-209.66),m.radians(-74.08),m.radians(-75.23),m.radians(-70.9),m.radians(-180)], acceleration, velocity)

for i, (wp_list, vel_list, accel_list) in enumerate(zip(way_plane_nlist, material_nlist, vel_nlist, accel_nlist)):
    for j,(wp, material, vel, accel) in enumerate(zip(wp_list, vel_list, accel_list)):
        script += "    "+ ur.move_l(wp, accel, vel)

script_D = c.concatenate_script("def drop():",script)
# ---------- end dropping ----------

# ----
# Send to UR
send_to_ur = GhPythonScript(script_D=dropping, send_dropping=send_dropping)  # inputs send_dropping: Boolean
# ---------- send_to_ur: Python ----------
from compas_rhino import unload_modules
unload_modules('simple_comm')
import simple_comm as c


if send_dropping:
    c.send_script(script_D, "192.168.10.10")
# ---------- end send_to_ur ----------
